# Grasshopper definition Rebuild curve.gh (Grasshopper 1.0.7)
# plug-ins: Bifocals

# ----
# 2. Define average
# distance between
# control points.
# Clear values in
# curve container
# above once happy.
# 2. Define the average distance between the control points. It is not adviable to
# use a value below 0.1mm as the laser cutter and Zünd may not perform well
# below this value. It would also be a lot of information for your comuter to process.
# Once you are happy with the look of the curve, clear the values
# of the curve container as it is just for a test.
tolerance = Slider(0.15, range=0.1..2)

# ----
# 5.Set multiple curves.
# All of the Curves that
# you just split.
# 5. Set multiple curves in the curve container. Select all of the newly split curves. The function
# of this definintion is the rebuild the curves. To get the count, the length of the lines is divided by
# the tolerance that we set. Because we split the curves earlier the maxium count that
# we get is 1000 and will work fine with grasshopper.
curve = Curve([<curve referenced from the Rhino model> x640])

# ----
# Before inputing data into grasshopper you should scale your drawing so you are
# working at model scale in mm put all of curves want to rebuild into a sparate layer rhino.
# This should only contain curved geometry. The rebuilding process will make any staight
# lines curved and remove any tight corners. So be sure to put all of your straght geoemtry
# such as the boarder or any rectangular building footprints into another layer. Also make sure
# that join all the geometry you want to rebuild in rhino.
# 1. Set one curve.
# Less than 100mm
# in length to do an
# initial test
# 1. Set one curve that is less than 100mm in length because we can only
# rebuild a curve with a 1000 points in grasshopper and the minimum
# tolerance to set 0.1mm. To check the length of a curve in rhino, select the
# curve and type the command Length.
curve_2 = Curve()

length = Length(Curve=[curve_2, curve])
multiplication = Multiplication(A=tolerance, B="1000")
division = Division(A=length, B=tolerance)

# ----
# 3. Set multiple curves:
# All the the curves
# you want to rebuild
# 3. Set multiple curves: all of the curves that you want to rebuild.
# The function of this grasshopper definition is to find the points where to split our
# original curves. Grasshopper can only rebuild curves with a maximum of 1000
# control points. Therefore the lines have to be short enough so that they can be
# divided by 1000 with the tolerance we set.
curve_3 = Curve([<curve referenced from the Rhino model> x420])

panel = Panel(division)
rebuild_curve = RebuildCurve(Curve=[curve_2, curve], Degree="3", Count=division, Tangents=False)

# ----
# Maximum
# curve length
# (mm)
# All the curves should now be no longer than the maxium curve length that was defined in
# grasshopper. If not, then review previous steps. You can check this with SelShortCrv
# command in rhino.
panel_2 = Panel(multiplication)

# ----
# Bake final
# geometry
# 6. Finally the split curves are joined which can then be baked.
join_curves = JoinCurves(Curves=rebuild_curve, Preserve=False)

# ----
# 4.Bake points into rhino. Then, in rhino,
# use the points to split the curves.
# 4. Bake the points into new layer in rhino. Type split into the command bar in rhino.
# Select the curves and press enter. Select the control points and press enter again.
divide_length = DivideLength(Curve=curve_3, Length=multiplication)  # -> Points, Tangents, Parameters
